# Grasshopper definition urdf_loader.gh (Grasshopper 1.0.8)
# plug-ins: RhinoCodePluginGH

panel = Panel("/Users/avery_tsai/project/hiwin_prc/config/output.jsonl")
py3 = Python3Script(Path=panel, Reload=Button())  # -> out, Data, Text, JOSNL; inputs Path: String, Reload: Boolean
# ---------- py3: Python ----------
# ========== Trajectory Loader (python01) ==========
# Inputs:
#   Path   (str)  - JSON file path (default: /Users/avery_tsai/project/hiwin_prc/config/output.json)
#   Reload (bool) - Force reload, clear cache (default: False)
# Outputs:
#   Data  (any)  - Raw JSON content (dict/list)
#   Text  (str)  - Raw JSON string (optional)
#   JSONL (str) - Converted JSONL text (one JSON row per line)
#   Lines (list) - JSONL lines as list of strings
#   OutPath (str) - Where JSONL was (would be) written on disk
#   Count (int) - Number of frames/lines parsed

#
# Notes:
# - Designed for Grasshopper GhPython. Paste the file content into a GhPython component
#   or use execfile() / import techniques as you prefer.

import os
import json

try:
    import scriptcontext as sc
except ImportError:
    sc = None

CACHE_KEY = 'GH_TRAJ_CACHE'


def _get_cache():
    if sc is None:
        return {}
    if not hasattr(sc, 'sticky'):
        return {}
    cache = sc.sticky.get(CACHE_KEY)
    if cache is None:
        cache = {}
        sc.sticky[CACHE_KEY] = cache
    return cache


def _read_json_obj(path):
    # Prefer UTF-8; fall back to UTF-8-sig if BOM exists
    try:
        with open(path, 'r', encoding='utf-8') as f:
            return json.load(f)
    except ValueError:
        with open(path, 'r', encoding='utf-8-sig') as f:
            return json.load(f)


def _read_text(path):
    # Read as text for debugging/inspection
    try:
        with open(path, 'r', encoding='utf-8') as f:
            return f.read()
    except Exception:
        with open(path, 'r', encoding='utf-8-sig', errors='ignore') as f:
            return f.read()

# ===== Helpers for JSON -> JSONL (joint1..joint6) =====

def _normalize_name(name):
    try:
        return str(name).strip().lower().replace('_', '')
    except Exception:
        return ''


def _pick_value_by_name(names, positions, j_index):
    target = 'joint{}'.format(j_index)
    try:
        norm = [_normalize_name(n) for n in (names or [])]
        for i, n in enumerate(norm):
            if n == target:
                return float(positions[i]) if i < len(positions or []) else 0.0
    except Exception:
        pass
    # fallback by index (1-based)
    if isinstance(positions, (list, tuple)) and len(positions) >= j_index:
        return float(positions[j_index - 1])
    return 0.0


def _ensure_six(values):
    vals = list(values[:6]) if isinstance(values, (list, tuple)) else []
    if len(vals) < 6:
        vals += [0.0] * (6 - len(vals))
    return vals


def _parse_frames_any(obj):
    # Shape C: {"joint_names": [...], "points": [ {"positions": [...]}, ... ]}
    if isinstance(obj, dict) and isinstance(obj.get('points'), list):
        names = obj.get('joint_names') or obj.get('names') or []
        if not isinstance(names, (list, tuple)):
            names = []
        frames = []
        for pt in obj['points']:
            if not isinstance(pt, dict):
                continue
            positions = pt.get('positions') or pt.get('position') or []
            if not isinstance(positions, (list, tuple)):
                positions = []
            jvals = [
                _pick_value_by_name(names, positions, 1),
                _pick_value_by_name(names, positions, 2),
                _pick_value_by_name(names, positions, 3),
                _pick_value_by_name(names, positions, 4),
                _pick_value_by_name(names, positions, 5),
                _pick_value_by_name(names, positions, 6),
            ]
            jvals = _ensure_six(jvals)
            frames.append({
                'joint1': jvals[0],
                'joint2': jvals[1],
                'joint3': jvals[2],
                'joint4': jvals[3],
                'joint5': jvals[4],
                'joint6': jvals[5],
            })
        return frames

    # Shape A/B: joint_states list or plain list of entries
    seq = None
    if isinstance(obj, dict):
        if isinstance(obj.get('joint_states'), list):
            seq = obj['joint_states']
        else:
            # fallback: first list-like value
            for v in obj.values():
                if isinstance(v, list):
                    seq = v
                    break
    elif isinstance(obj, list):
        seq = obj

    if not isinstance(seq, list) or not seq:
        return []

    frames = []
    for entry in seq:
        if not isinstance(entry, dict):
            continue
        names = entry.get('name') or entry.get('names') or []
        positions = entry.get('position') or entry.get('positions') or []
        if not isinstance(names, (list, tuple)):
            names = []
        if not isinstance(positions, (list, tuple)):
            positions = []
        jvals = [
            _pick_value_by_name(names, positions, 1),
            _pick_value_by_name(names, positions, 2),
            _pick_value_by_name(names, positions, 3),
            _pick_value_by_name(names, positions, 4),
            _pick_value_by_name(names, positions, 5),
            _pick_value_by_name(names, positions, 6),
        ]
        jvals = _ensure_six(jvals)
        frames.append({
            'joint1': jvals[0],
            'joint2': jvals[1],
            'joint3': jvals[2],
            'joint4': jvals[3],
            'joint5': jvals[4],
            'joint6': jvals[5],
        })
    return frames


def _frames_to_jsonl_lines(frames):
    try:
        return [json.dumps(row, ensure_ascii=False) for row in frames]
    except Exception:
        return []


def _write_text_safe(path, text):
    try:
        with open(path, 'w') as f:
            f.write(text)
    except Exception:
        pass

        with open(path, 'r', encoding='utf-8') as f:
            return f.read()
    except Exception:
        with open(path, 'r', encoding='utf-8-sig', errors='ignore') as f:
            return f.read()


def _extract_stamp(entry):
    # Try common stamp fields: time, stamp, header.stamp
    t = entry.get('time')
    if isinstance(t, (int, float)):
        return float(t)

    stamp = entry.get('stamp') or entry.get('header', {}).get('stamp')
    if isinstance(stamp, dict):
        secs = stamp.get('secs') or stamp.get('sec') or stamp.get('seconds') or 0
        nsecs = stamp.get('nsecs') or stamp.get('nanosec') or stamp.get('nanosecs') or 0
        try:
            return float(secs) + float(nsecs) * 1e-9
        except Exception:
            return None
    return None


def _parse_joint_states(obj):
    # Accept two shapes:
    # 1) {"joint_states": [ {"name": [...], "position": [...], ...}, ... ]}
    # 2) [ {"name": [...], "position": [...], ...}, ... ]
    seq = None
    if isinstance(obj, dict):
        if 'joint_states' in obj and isinstance(obj['joint_states'], list):
            seq = obj['joint_states']
        else:
            # allow dict of frames keyed by something
            # fallback to values if they look like frames
            vals = list(obj.values())
            if vals and isinstance(vals[0], list):
                seq = vals[0]
    if seq is None and isinstance(obj, list):
        seq = obj
    if not isinstance(seq, list):
        return [], [], [], 0

    if not seq:
        return [], [], [], 0

    first = seq[0]
    names = list(first.get('name') or first.get('names') or [])
    if not names:
        # try common joint names default
        # if absent, attempt to infer from URDF typical pattern
        names = ['joint_1','joint_2','joint_3','joint_4','joint_5','joint_6']

    frames = []
    times = []

    for entry in seq:
        pos = entry.get('position') or entry.get('positions') or []
        if not pos or len(pos) < len(names):
            # pad/truncate to names length
            pos = (list(pos) + [0.0] * len(names))[:len(names)]
        frame = {names[i]: float(pos[i]) for i in range(len(names))}
        frames.append(frame)
        times.append(_extract_stamp(entry))

    return frames, names, times, len(frames)


# -------- Grasshopper entry point --------
try:
    default_path = r"/Users/avery_tsai/project/hiwin_prc/config/output.json"
    _path = Path if 'Path' in globals() and Path else default_path
    _reload = Reload if 'Reload' in globals() else False

    Data = None
    Text = ''
    JSONL = ''
    Lines = []
    OutPath = ''
    Count = 0

    if _path and os.path.exists(_path):
        cache = _get_cache()
        mtime = os.path.getmtime(_path)
        ext = os.path.splitext(_path)[1].lower()
        key = ('TRAJ_JSON_JSONL', os.path.abspath(_path), mtime, ext)

        if _reload and cache:
            cache.clear()

        if key in cache:
            Data, Text, JSONL, Lines, OutPath, Count = cache[key]
        else:
            abspath = os.path.abspath(_path)
            if ext == '.jsonl':
                Text = _read_text(_path)
                Lines = [ln for ln in Text.splitlines() if ln.strip()]
                JSONL = '\n'.join(Lines) + ('\n' if Lines else '')
                OutPath = abspath
                Count = len(Lines)
                Data = None
            else:
                # Treat as JSON and convert to JSONL
                Data = _read_json_obj(_path)
                Text = _read_text(_path)
                frames = _parse_frames_any(Data)
                Lines = _frames_to_jsonl_lines(frames)
                JSONL = '\n'.join(Lines) + ('\n' if Lines else '')
                Count = len(Lines)
                OutPath = os.path.splitext(abspath)[0] + '.jsonl'
                if JSONL:
                    _write_text_safe(OutPath, JSONL)
            cache[key] = (Data, Text, JSONL, Lines, OutPath, Count)

except Exception:
    Data, Text, JSONL, Lines, OutPath, Count = None, '', '', [], '', 0
# ---------- end py3 ----------
txt = Text()
panel_2 = Panel(py3.Text)
py3_2 = Python3Script(Path=panel, S=Slider(1, range=0..1))  # -> out, J, Count, Line; inputs Lines: list of String, Path: String, S: Double
# ---------- py3_2: Python ----------
# ========== Trajectory JSONL Player (python02) ==========
# Inputs:
#   Lines (list[str]) - JSONL lines, each line like {"joint1": ..., ..., "joint6": ...}
#   JSONL (str)       - Raw JSONL text (fallback if Lines not provided)
#   Path  (str)       - Path to a .jsonl file (fallback if neither Lines nor JSONL provided)
#   S     (float)     - Normalized slider [0..1] to select line (preferred)
#   Index (int)       - Legacy index (0-based); used if S not provided
# Outputs:
#   J     (list[float]) - [joint1..joint6] for the selected line
#   Count (int)         - Number of lines
#   Line  (str)         - The selected raw JSONL line
#   I     (int)         - The selected 0-based index

import os
import json


def _read_text(path):
    try:
        with open(path, 'r', encoding='utf-8') as f:
            return f.read()
    except Exception:
        try:
            with open(path, 'r', encoding='utf-8-sig', errors='ignore') as f:
                return f.read()
        except Exception:
            return ''


def _build_lines():
    # Prefer Lines input if present
    lines_val = globals().get('Lines', None)
    if isinstance(lines_val, (list, tuple)):
        return [str(x) for x in lines_val if str(x).strip()]
    # Fallback to JSONL text
    jsonl_val = globals().get('JSONL', None)
    if isinstance(jsonl_val, str) and jsonl_val:
        return [ln for ln in jsonl_val.splitlines() if ln.strip()]
    # Fallback to Path to read file
    path_val = globals().get('Path', None)
    if path_val:
        text = _read_text(path_val)
        if text:
            return [ln for ln in text.splitlines() if ln.strip()]
    return []


def _to_index(count):
    if count <= 0:
        return 0
    s_val = globals().get('S', None)
    if s_val is None:
        s_val = globals().get('Phase', None)
    if s_val is not None:
        try:
            s = float(s_val)
        except Exception:
            s = 0.0
        if s < 0.0:
            s = 0.0
        if s > 1.0:
            s = 1.0
        return int(round(s * (count - 1))) if count > 1 else 0
    i_val = globals().get('Index', None)
    if i_val is not None:
        try:
            i = int(i_val)
        except Exception:
            i = 0
        if i < 0:
            i = 0
        if i >= count:
            i = count - 1
        return i
    return 0


def _parse_joints_from_line(line):
    # Expect dict with joint1..joint6; provide a fallback for position arrays
    try:
        obj = json.loads(line)
    except Exception:
        return [0.0, 0.0, 0.0, 0.0, 0.0, 0.0]

    if isinstance(obj, dict):
        # Primary: joint1..joint6
        keys = ['joint1','joint2','joint3','joint4','joint5','joint6']
        if all(k in obj for k in keys):
            try:
                vals = [float(obj.get(k, 0.0)) for k in keys]
                return (vals + [0.0] * 6)[:6]
            except Exception:
                pass
        # Fallback: positions/position list
        pos = obj.get('positions') or obj.get('position') or obj.get('J')
        if isinstance(pos, (list, tuple)):
            try:
                vals = [float(v) for v in pos]
                vals = (vals + [0.0] * 6)[:6]
                return vals
            except Exception:
                pass
    return [0.0, 0.0, 0.0, 0.0, 0.0, 0.0]


# -------- Grasshopper entry point --------
try:
    _lines = _build_lines()
    Count = len(_lines)

    if Count <= 0:
        J, Line, I = [], '', 0
    else:
        I = _to_index(Count)
        Line = _lines[I]
        J = _parse_joints_from_line(Line)

except Exception:
    J, Count, Line, I = [], 0, '', 0
# ---------- end py3_2 ----------
item = ListItem(List=py3_2.J, Index=0, Wrap=True)  # -> Item, Item1, Item2, Item3, Item4, Item5
trigger = Trigger(Interval=500, TimerInterval=500, Target=py3_3)
py3_3 = Python3Script(IP="192.168.0.216", Start=Toggle(True))  # -> out, joints_state; inputs IP: String, Start: Boolean
# ---------- py3_3: Python ----------
# Grasshopper: ROS joint state subscriber via rosbridge
# Inputs:
#   start (bool)      - start/stop the subscriber (True to connect, False to disconnect)
#   ip (str)          - rosbridge host, default "localhost"
# Outputs:
#   joints_state (list) - latest positions array from sensor_msgs/JointState
# requirements: roslibpy
# requirements: roslibpy

import sys
import json

try:
    import scriptcontext as sc
except ImportError:
    sc = None  # Running outside Rhino/Grasshopper

# Try to import roslibpy (Python client for rosbridge)
try:
    import roslibpy
except ImportError:
    roslibpy = None

STATE_KEY = 'ROS_JOINT_SUBSCRIBER_STATE'
DEFAULT_PORT = 9090
TOPIC_NAME = '/joint_states_target'
TOPIC_TYPE = 'sensor_msgs/JointState'


def _get_state():
    state = None
    if sc is not None:
        state = sc.sticky.get(STATE_KEY)
        if state is None:
            state = {'ros': None, 'topic': None, 'positions': [], 'connected': False}
            sc.sticky[STATE_KEY] = state
    else:
        # Fallback for non-GH environments
        if not hasattr(_get_state, '_state'):
            _get_state._state = {'ros': None, 'topic': None, 'positions': [], 'connected': False}
        state = _get_state._state
    return state


def _clear_state():
    if sc is not None and STATE_KEY in sc.sticky:
        del sc.sticky[STATE_KEY]
    else:
        if hasattr(_get_state, '_state'):
            _get_state._state = {'ros': None, 'topic': None, 'positions': [], 'connected': False}


def _on_message(state, msg):
    try:
        # sensor_msgs/JointState has fields: name[], position[], velocity[], effort[]
        positions = msg.get('position') or []
        # Make sure it's a plain Python list of floats
        state['positions'] = [float(x) for x in positions]
    except Exception:
        # On malformed data, do not break subscriber; keep last positions
        pass


def _ensure_connected(state, host, port):
    if state['ros'] is not None and getattr(state['ros'], 'is_connected', False):
        return True
    if roslibpy is None:
        return False
    try:
        ros = roslibpy.Ros(host=host, port=port)
        ros.run()  # starts background thread, non-blocking
        state['ros'] = ros
        state['connected'] = True
        return True
    except Exception:
        state['ros'] = None
        state['connected'] = False
        return False


def _ensure_subscribed(state):
    if roslibpy is None:
        return False
    if state['ros'] is None or not state['ros'].is_connected:
        return False
    if state['topic'] is None:
        try:
            topic = roslibpy.Topic(state['ros'], TOPIC_NAME, TOPIC_TYPE)
            # Bind callback with state
            topic.subscribe(lambda msg: _on_message(state, msg))
            state['topic'] = topic
        except Exception:
            state['topic'] = None
            return False
    return True


def _disconnect(state):
    # Unsubscribe and close connection
    try:
        if state.get('topic') is not None:
            try:
                state['topic'].unsubscribe()
            except Exception:
                pass
            state['topic'] = None
        if state.get('ros') is not None:
            try:
                state['ros'].close()
            except Exception:
                pass
            state['ros'] = None
    finally:
        state['connected'] = False


# -------- Grasshopper IO handling --------

# Defaults for GH inputs
try:
    start  # type: ignore[name-defined]
except NameError:
    start = False  # type: ignore[assignment]

try:
    ip  # type: ignore[name-defined]
except NameError:
    ip = 'localhost'  # type: ignore[assignment]

state = _get_state()

if not start:
    # Stop and clean
    _disconnect(state)
    joints_state = list(state.get('positions') or [])  # type: ignore[name-defined]
else:
    # Start / keep running
    host = ip or 'localhost'
    if _ensure_connected(state, host, DEFAULT_PORT):
        _ensure_subscribed(state)
    else:
        # Not connected (roslibpy missing or connection failed)
        pass
    joints_state = list(state.get('positions') or [])  # type: ignore[name-defined]

# Helpful message when roslibpy is missing (visible in GH out panel if user prints it)
if roslibpy is None:
    # You can install with: pip install roslibpy
    # In Rhino 8 CPython: Tools > Python > Manage Packages ...
    # Or run in your environment/venv.
    try:
        _ = joints_state  # type: ignore[name-defined]
    except Exception:
        pass
# ---------- end py3_3 ----------
number_slider = Slider(-47, range=-150..95)
number_slider_2 = Slider(27, range=-85..185)
number_slider_3 = Slider(-16, range=-135..135)
number_slider_4 = Slider(43, range=-360..360)
number_slider_5 = Slider(-47, range=-190..190)
number_slider_6 = Slider(50, range=-170..170)
panel_3 = Panel("/Users/avery_tsai/OrbStack/docker/volumes/walker_arm/src/walker_arm/hiwin_description")
panel_4 = Panel(py3_3.out)
merge = Merge(Data1=item.Item, Data2=item.Item1, Data3=item.Item2, Data4=item.Item3, Data5=item.Item4, Data6=item.Item5)
panel_5 = Panel("/Users/avery_tsai/OrbStack/docker/volumes/walker_arm/src/walker_arm/hiwin_description/urdf/rebar_arm.urdf")
merge_2 = Merge(
    Data1=Slider(-88, range=-185..85),
    Data2=Slider(-79, range=-155..35),
    Data3=Slider(117, range=-130..154),
    Data4=Slider(87, range=-350..350),
    Data5=Slider(3, range=-130..130),
    Data6=Slider(61, range=-350..350))
py3_4 = Python3Script(DirPath=panel_3, Reload=Button())  # -> out, Meshes, Paths; inputs DirPath: String, Reload: Boolean
# ---------- py3_4: Python ----------
# ========== 電池01：載入網格 ==========
# 輸入：DirPath (str), Reload (bool)
# 輸出：Meshes, Paths

import sys
sys.path.append(r"/Users/avery_tsai/project/hiwin_prc")
from robot import mesh_loader

# 載入網格（自動遞迴搜尋 .stl 檔案）
Meshes, Paths = mesh_loader.load(
    DirPath if 'DirPath' in globals() and DirPath else r"/Users/avery_tsai/project/hiwin_prc/urdf/walker_arm",
    Reload if 'Reload' in globals() else False
)

a = Meshes
# ---------- end py3_4 ----------
panel_6 = Panel("/Users/avery_tsai/project/robosim/urdf/kuka_kr300_support/urdf/kr300r2500ultra.urdf")
toggle = BooleanToggle(False)
button = Button()
py3_5 = Python3Script(DirPath="/Users/avery_tsai/project/robosim/urdf/kuka_kr300_support", Reload=Button())  # -> out, Meshes, Paths; inputs DirPath: String, Reload: Boolean; same code as py3_4
py3_6 = Python3Script(URDFPath=panel_5, Meshes=py3_4.Meshes, MeshPaths=py3_4.Paths, J=merge, Deg=toggle, Reload=button)  # -> out, G, a, Names, JointOrder; inputs URDFPath: String, Meshes: list of Mesh, MeshPaths: list of String, J: list of Double, Deg: Boolean, Reload: Boolean
# ---------- py3_6: Python ----------
# ========== 電池02：URDF 運動學 ==========
# 輸入：URDFPath (str), Meshes (list), MeshPaths (list), J (list), Deg (bool), Reload (bool)
# 輸出：G, Names, JointOrder

import sys
sys.path.append(r"/Users/avery_tsai/project/hiwin_prc")
from robot import urdf_loader

# 載入 URDF 並計算運動學
G, Names, JointOrder = urdf_loader.load(
    URDFPath if 'URDFPath' in globals() and URDFPath else r"/Users/avery_tsai/project/hiwin_prc/urdf/walker_arm/urdf/walker_arm.urdf",
    Meshes if 'Meshes' in globals() else [],
    MeshPaths if 'MeshPaths' in globals() else [],
    J if 'J' in globals() and J else [0, 0, 0, 0, 0, 0],
    Deg if 'Deg' in globals() else True,
    Reload if 'Reload' in globals() else False
)

a = G
# ---------- end py3_6 ----------
py3_7 = Python3Script(URDFPath=panel_6, Meshes=py3_5.Meshes, MeshPaths=py3_5.Paths, J=merge_2, Deg=Toggle(True), Reload=Button())  # -> out, G, a, Names, JointOrder; inputs URDFPath: String, Meshes: list of Mesh, MeshPaths: list of String, J: list of Double, Deg: Boolean, Reload: Boolean; same code as py3_6
ipy2 = IronPython2Script(URDFPath=panel_5, Meshes=py3_4.Meshes, MeshPaths=py3_4.Paths, J=merge, Deg=toggle, Reload=button)  # -> out, G, a; inputs URDFPath: String, Meshes: list of Mesh, MeshPaths: list of String, J: list, Deg: Boolean, Reload: Boolean
# ---------- ipy2: IronPython ----------
import sys
sys.path.append(r"/Users/avery_tsai/project/hiwin_prc")
from robot import urdf_loader

# 載入 URDF 並計算運動學
G, Names, JointOrder = urdf_loader.load(
    URDFPath if 'URDFPath' in globals() and URDFPath else r"/Users/avery_tsai/project/hiwin_prc/urdf/walker_arm/urdf/walker_arm.urdf",
    Meshes if 'Meshes' in globals() else [],
    MeshPaths if 'MeshPaths' in globals() else [],
    J if 'J' in globals() and J else [0, 0, 0, 0, 0, 0],
    Deg if 'Deg' in globals() else True,
    Reload if 'Reload' in globals() else False
)

a = G
# ---------- end ipy2 ----------
scale = Scale(Center=Point(0, 0, 0), Factor=Slider(1000, range=0..1000))  # -> Geometry, Transform
scale_2 = Scale(Geometry=py3_6.G, Center=Point(0, 0, 0), Factor=Slider(1000, range=0..1000))  # -> Geometry, Transform
panel_7 = Panel(py3_7.G)
panel_8 = Panel(py3_6.JointOrder)
