# Grasshopper definition motion_command.gh (Grasshopper 1.0.8)
# plug-ins: RhinoCodePluginGH

number_slider = Slider(0, range=0..100)
series = Series(Start=0, Step=Slider(22, range=0..100), Count=10)
xy = XYPlane(Origin=Point(0, 0, 0))
Z = UnitZ(Factor=series)
merge = Merge(
    Data1=number_slider,
    Data2=number_slider,
    Data3=number_slider,
    Data4=number_slider,
    Data5=number_slider,
    Data6=number_slider)
move = Move(Geometry=xy, Motion=Z)  # -> Geometry, Transform
movej = Python3Script(plane=move.Geometry)  # -> movej_command; inputs plane: Plane
# ---------- movej: Python ----------
import math
import json
from collections import OrderedDict

try:
    import Rhino.Geometry as rg
except Exception:
    rg = None


def _compute_rpy_from_axes(x_axis, y_axis, z_axis):
    """Compute roll, pitch, yaw (deg) from right-handed axes using ZYX convention.

    R = Rz(yaw) * Ry(pitch) * Rx(roll)
    Columns of rotation matrix are the axis unit vectors in world coordinates.
    """
    r11 = x_axis.X
    r12 = y_axis.X
    r13 = z_axis.X
    r21 = x_axis.Y
    r22 = y_axis.Y
    r23 = z_axis.Y
    r31 = x_axis.Z
    r32 = y_axis.Z
    r33 = z_axis.Z

    sy = math.sqrt(r11 * r11 + r21 * r21)
    singular = sy < 1e-9

    if not singular:
        yaw = math.degrees(math.atan2(r21, r11))
        pitch = math.degrees(math.atan2(-r31, sy))
        roll = math.degrees(math.atan2(r32, r33))
    else:
        # Gimbal lock
        yaw = math.degrees(math.atan2(-r12, r22))
        pitch = math.degrees(math.atan2(-r31, sy))
        roll = 0.0

    return roll, pitch, yaw


def _build_axes_from_z(z_axis):
    """Given a Z axis (Vector3d), build a stable right-handed frame (X, Y, Z).

    Uses world X as reference; if nearly parallel, switches to world Y.
    X = Z x refX; Y = Z x X.
    """
    z = rg.Vector3d(z_axis)
    if not z.Unitize():
        raise ValueError("Z axis vector cannot be zero-length")

    ref_x = rg.Vector3d(1.0, 0.0, 0.0)
    if abs(rg.Vector3d.Multiply(z, ref_x)) > 0.99:  # nearly parallel
        ref_x = rg.Vector3d(0.0, 1.0, 0.0)

    x = rg.Vector3d.CrossProduct(z, ref_x)
    _ = x.Unitize()
    y = rg.Vector3d.CrossProduct(z, x)
    _ = y.Unitize()

    return x, y, z


def plane_to_movej(plane):
    """Convert a Rhino Plane to moveJ dict with meters and ZYX Euler angles (deg).

    - Position: mm -> m
    - Orientation: use Plane.XAxis/YAxis/ZAxis directly (deconstruct plane), then RPY (deg)
    - motion_type is always "moveJ"
    """
    if rg is None:
        raise RuntimeError("Rhino.Geometry not available. This script is intended for Rhino/Grasshopper.")

    origin = plane.Origin
    x_m = origin.X / 1000.0
    y_m = origin.Y / 1000.0
    z_m = origin.Z / 1000.0

    # Deconstruct Plane: use plane's axes to preserve its rotation
    x_axis = rg.Vector3d(plane.XAxis); x_axis.Unitize()
    y_axis = rg.Vector3d(plane.YAxis); y_axis.Unitize()
    z_axis = rg.Vector3d(plane.ZAxis); z_axis.Unitize()
    roll_deg, pitch_deg, yaw_deg = _compute_rpy_from_axes(x_axis, y_axis, z_axis)

    result = OrderedDict([
        ("motion_type", "moveJ"),
        ("x", round(x_m, 3)),
        ("y", round(y_m, 3)),
        ("z", round(z_m, 3)),
        ("roll", round(roll_deg, 3)),
        ("pitch", round(pitch_deg, 3)),
        ("yaw", round(yaw_deg, 3)),
    ])
    return result


# Grasshopper convenience: if a variable named `plane` exists in the scope,
# compute outputs `result` and `movej_command` for direct wiring.
try:  # noqa: SIM105
    plane  # type: ignore[name-defined]
    if plane is not None and rg is not None:
        result = plane_to_movej(plane)  # type: ignore[name-defined]
        movej_command = json.dumps(result, sort_keys=False)
except NameError:
    pass
# ---------- end movej ----------
movel = Python3Script(plane=move.Geometry)  # -> movel_command; inputs plane: Plane
# ---------- movel: Python ----------
import math
import json
from collections import OrderedDict

try:
    import Rhino.Geometry as rg
except Exception:
    rg = None


def _compute_rpy_from_axes(x_axis, y_axis, z_axis):
    """Compute roll, pitch, yaw (deg) from right-handed axes using ZYX convention.

    R = Rz(yaw) * Ry(pitch) * Rx(roll)
    Columns of rotation matrix are the axis unit vectors in world coordinates.
    """
    r11 = x_axis.X
    r12 = y_axis.X
    r13 = z_axis.X
    r21 = x_axis.Y
    r22 = y_axis.Y
    r23 = z_axis.Y
    r31 = x_axis.Z
    r32 = y_axis.Z
    r33 = z_axis.Z

    sy = math.sqrt(r11 * r11 + r21 * r21)
    singular = sy < 1e-9

    if not singular:
        yaw = math.degrees(math.atan2(r21, r11))
        pitch = math.degrees(math.atan2(-r31, sy))
        roll = math.degrees(math.atan2(r32, r33))
    else:
        # Gimbal lock
        yaw = math.degrees(math.atan2(-r12, r22))
        pitch = math.degrees(math.atan2(-r31, sy))
        roll = 0.0

    return roll, pitch, yaw


def _build_axes_from_z(z_axis):
    """Given a Z axis (Vector3d), build a stable right-handed frame (X, Y, Z).

    Uses world X as reference; if nearly parallel, switches to world Y.
    X = Z x refX; Y = Z x X.
    """
    z = rg.Vector3d(z_axis)
    if not z.Unitize():
        raise ValueError("Z axis vector cannot be zero-length")

    ref_x = rg.Vector3d(1.0, 0.0, 0.0)
    if abs(rg.Vector3d.Multiply(z, ref_x)) > 0.99:  # nearly parallel
        ref_x = rg.Vector3d(0.0, 1.0, 0.0)

    x = rg.Vector3d.CrossProduct(z, ref_x)
    _ = x.Unitize()
    y = rg.Vector3d.CrossProduct(z, x)
    _ = y.Unitize()

    return x, y, z


def plane_to_movel(plane):
    """Convert a Rhino Plane to moveL dict with meters and ZYX Euler angles (deg).

    - Position: mm -> m
    - Orientation: use Plane.XAxis/YAxis/ZAxis directly (deconstruct plane), then RPY (deg)
    - motion_type is always "moveL"
    """
    if rg is None:
        raise RuntimeError("Rhino.Geometry not available. This script is intended for Rhino/Grasshopper.")

    origin = plane.Origin
    x_m = origin.X / 1000.0
    y_m = origin.Y / 1000.0
    z_m = origin.Z / 1000.0

    # Deconstruct Plane: use plane's axes to preserve its rotation
    x_axis = rg.Vector3d(plane.XAxis); x_axis.Unitize()
    y_axis = rg.Vector3d(plane.YAxis); y_axis.Unitize()
    z_axis = rg.Vector3d(plane.ZAxis); z_axis.Unitize()
    roll_deg, pitch_deg, yaw_deg = _compute_rpy_from_axes(x_axis, y_axis, z_axis)

    result = OrderedDict([
        ("motion_type", "moveL"),
        ("x", round(x_m, 3)),
        ("y", round(y_m, 3)),
        ("z", round(z_m, 3)),
        ("roll", round(roll_deg, 3)),
        ("pitch", round(pitch_deg, 3)),
        ("yaw", round(yaw_deg, 3)),
    ])
    return result


# Grasshopper convenience: if a variable named `plane` exists in the scope,
# compute outputs `result` and `movel_command` for direct wiring.
try:  # noqa: SIM105
    plane  # type: ignore[name-defined]
    if plane is not None and rg is not None:
        result = plane_to_movel(plane)  # type: ignore[name-defined]
        movel_command = json.dumps(result, sort_keys=False)
except NameError:
    pass


# O(-500.00,1000.00,50.00) Z(0.00,0.00,1.00) 這是 grasshopper 中輸入的 plane。
# 請幫我將 @moveL_movement.py.py  中，透過 rhino/grasshopper 語法專換為歐拉角
# ---------- end movel ----------
axis = Python3Script(joints=merge)  # -> axis_command; inputs joints: list
# ---------- axis: Python ----------
import json

if 'joints' not in locals() or len(joints) != 6:
    raise ValueError("輸入的 'joints' 必須是一個包含 6 個數值的 list。")

axis_data = {
    "motion_type": "axis",
    "joint1": float(joints[0]),
    "joint2": float(joints[1]),
    "joint3": float(joints[2]),
    "joint4": float(joints[3]),
    "joint5": float(joints[4]),
    "joint6": float(joints[5])
}
# result 可輸出 dict 或 JSON 字串，依 GH 需求選擇
result = axis_data
# 若要輸出 JSON 字串，請取消註解下行
# result = json.dumps(axis_data, indent=4)
axis_command = json.dumps(axis_data)
# ---------- end axis ----------
merge_2 = Merge(Data1=movej, Data2=movel, Data3=axis)  # -> flatten(Result)
panel = Panel(axis)
panel_2 = Panel(movej)
exporter = Python3Script(data=merge_2, file_path="/Users/avery_tsai/project/hiwin_prc/config/cc1122.jsonl", button=Button())  # -> result; inputs data: list of String, file_path: String, button: Boolean
# ---------- exporter: Python ----------
import os

def export_raw(data, file_path):
    """
    將資料原封不動地寫入指定路徑
    data: 任意類型
    file_path: 絕對路徑
    """
    os.makedirs(os.path.dirname(file_path), exist_ok=True)
    with open(file_path, "w", encoding="utf-8") as f:
        f.write(str(data))

def export_jsonl(data, file_path):
    """
    將 list of JSON 字串逐行寫入標準 jsonl 格式
    data: list[str]，每個元素都是 JSON 字串
    file_path: 絕對路徑
    """
    import os
    os.makedirs(os.path.dirname(file_path), exist_ok=True)
    with open(file_path, "w", encoding="utf-8") as f:
        for line in data:
            f.write(line.rstrip("\n") + "\n")

# Grasshopper端：
# 輸入 data (list[str])、file_path (str)、button (bool)
# 直接呼叫 export_jsonl(data, file_path)
if button == True:
    try:
        data  # type: ignore[name-defined]
        file_path  # type: ignore[name-defined]
        export_jsonl(data, file_path)
        result = True
    except Exception as e:
        result = False
        error_msg = str(e)
# ---------- end exporter ----------
panel_3 = Panel(exporter)
